# Dynamo graph all_objects.dyn (Dynamo 1.3.3.4111)

file_path = Filename("..\csv\wall.csv")
walls = Python()  # unwired: IN[0]
# ---------- walls.python (117 lines) ----------
import sys
import clr
# import Revit API
clr.AddReference('RevitAPI')
from Autodesk.Revit.DB import *
# import Revit API UI
clr.AddReference('RevitAPIUI')
# import Revit Services
clr.AddReference('RevitServices')
import RevitServices
from RevitServices.Persistence import DocumentManager
from RevitServices.Transactions import TransactionManager 
# import ProtoGeometry 
clr.AddReference('ProtoGeometry')
from Autodesk.DesignScript.Geometry import *
# get the current Revit Document 
doc = DocumentManager.Instance.CurrentDBDocument
# get the current Revit application
app = DocumentManager.Instance.CurrentUIApplication.Application
# get the current UI application
uiapp = DocumentManager.Instance.CurrentUIApplication
app = uiapp.Application


list_categories = FilteredElementCollector(doc).OfCategory(BuiltInCategory.OST_Walls).WhereElementIsNotElementType().ToElements()

list1 = []
list2 = []
list3 = []
list4 = []
list5 = []
list6 = []
list7 = []
list8 = []
list9 = []
list10 = []
list11 = []
list12 = []
list13 = []
list14 = []
list15 = []

for p in list_categories:
	typeId = p.GetTypeId()
	type = doc.GetElement(typeId)
	try:
		a = p.Id
	except:
		a = 0
	list1.append(a)
	try:
		b = p.UniqueId
	except:
		b = 0
	list2.append(b)
	try:
		c = p.LookupParameter("Navisworks").AsString()
	except:
		c = 0
	list3.append(c)
	try:
		d = p.LookupParameter("Базовая зависимость").AsValueString()
	except:
		d = 0
	list4.append(d)
	try:
		e = p.LookupParameter("Номер секции №").AsString()
	except:
		e = 0
	list5.append(e)
	try:
		f = p.LookupParameter("Категория").AsValueString()
	except:
		f = 0
	list6.append(f)
	try:
		g = p.Name
	except:
		g = 0
	list7.append(g)
	try:
		h = p.LookupParameter("Длина").AsValueString()
	except:
		h = 0
	list9.append(h)
	try:
		i = p.LookupParameter("Площадь").AsValueString()
	except:
		i = 0
	list10.append(i)
	try:
		j = p.LookupParameter("Объем").AsValueString()
	except:
		j = 0
	list11.append(j)
	try:
		k = p.LookupParameter("Смещение снизу").AsValueString()
	except:
		k = 0
	list12.append(k)
	try:
		l = p.LookupParameter("Смещение сверху").AsValueString()
	except:
		l = 0
	list13.append(l)
	try:
		o = p.Symbol.LookupParameter("Ширина").AsDouble()
	except:
		o = 0
	list14.append(str(o))
	try:
		w = p.Symbol.LookupParameter("Высота").AsDouble()
	except:
		w = 0
	list15.append(str(w))
	list7.append(type)
OUT = list1, list2, list3, list4, list5, list6, list7, list8, list9, list10, list11, list12, list13, list14, list15
# ----------------------------------------
code_block = CodeBlock(a=walls) { a[0]; a[1]; a[2]; a[3]; a[4]; a[5]; a[6]; a[7]; a[8]; a[9]; a[10]; a[11]; a[12]; a[13]; a[14]; }
create = List.Create(code_block.out0, code_block.out1, code_block.out2, code_block.out3, code_block.out4, code_block.out5, code_block.out6, code_block.out7, code_block.out8, code_block.out9, code_block.out10, code_block.out11, code_block.out12, code_block.out13, code_block.out14)
transpose = List.Transpose(create)
writeToFile = CSV.WriteToFile(file_path, transpose)
file_path_2 = Filename("..\csv\windows.csv")
windows = Python()  # unwired: IN[0]
# ---------- windows.python (117 lines) ----------
import sys
import clr
# import Revit API
clr.AddReference('RevitAPI')
from Autodesk.Revit.DB import *
# import Revit API UI
clr.AddReference('RevitAPIUI')
# import Revit Services
clr.AddReference('RevitServices')
import RevitServices
from RevitServices.Persistence import DocumentManager
from RevitServices.Transactions import TransactionManager 
# import ProtoGeometry 
clr.AddReference('ProtoGeometry')
from Autodesk.DesignScript.Geometry import *
# get the current Revit Document 
doc = DocumentManager.Instance.CurrentDBDocument
# get the current Revit application
app = DocumentManager.Instance.CurrentUIApplication.Application
# get the current UI application
uiapp = DocumentManager.Instance.CurrentUIApplication
app = uiapp.Application


list_categories = FilteredElementCollector(doc).OfCategory(BuiltInCategory.OST_Windows).WhereElementIsNotElementType().ToElements()

list1 = []
list2 = []
list3 = []
list4 = []
list5 = []
list6 = []
list7 = []
list8 = []
list9 = []
list10 = []
list11 = []
list12 = []
list13 = []
list14 = []
list15 = []

for p in list_categories:
	typeId = p.GetTypeId()
	type = doc.GetElement(typeId)
	try:
		a = p.Id
	except:
		a = 0
	list1.append(a)
	try:
		b = p.UniqueId
	except:
		b = 0
	list2.append(b)
	try:
		c = p.LookupParameter("Navisworks").AsString()
	except:
		c = 0
	list3.append(c)
	try:
		d = p.LookupParameter("Уровень").AsValueString()
	except:
		d = 0
	list4.append(d)
	try:
		e = p.LookupParameter("Номер секции №").AsString()
	except:
		e = 0
	list5.append(e)
	try:
		f = p.LookupParameter("Категория").AsValueString()
	except:
		f = 0
	list6.append(f)
	try:
		g = p.Name
	except:
		g = 0
	list8.append(g)
	try:
		h = p.LookupParameter("Длина").AsValueString()
	except:
		h = 0
	list9.append(h)
	try:
		i = p.LookupParameter("Площадь").AsValueString()
	except:
		i = 0
	list10.append(i)
	try:
		j = p.LookupParameter("Объем").AsValueString()
	except:
		j = 0
	list11.append(j)
	try:
		k = p.LookupParameter("Смещение снизу").AsValueString()
	except:
		k = 0
	list12.append(k)
	try:
		l = p.LookupParameter("Смещение сверху").AsValueString()
	except:
		l = 0
	list13.append(l)
	try:
		o = p.Symbol.LookupParameter("Ширина").AsDouble()
	except:
		o = 0
	list14.append(str(o))
	try:
		w = p.Symbol.LookupParameter("Высота").AsDouble()
	except:
		w = 0
	list15.append(str(w))
	list7.append(type)
OUT = list1, list2, list3, list4, list5, list6, list7, list8, list9, list10, list11, list12, list13, list14, list15
# ----------------------------------------
code_block_2 = CodeBlock(a=windows) { a[0]; a[1]; a[2]; a[3]; a[4]; a[5]; a[6]; a[7]; a[8]; a[9]; a[10]; a[11]; a[12]; a[13]; a[14]; }
create_2 = List.Create(code_block_2.out0, code_block_2.out1, code_block_2.out2, code_block_2.out3, code_block_2.out4, code_block_2.out5, code_block_2.out6, code_block_2.out7, code_block_2.out8, code_block_2.out9, code_block_2.out10, code_block_2.out11, code_block_2.out12, code_block_2.out13, code_block_2.out14)
transpose_2 = List.Transpose(create_2)
writeToFile_2 = CSV.WriteToFile(file_path_2, transpose_2)
file_path_3 = Filename("..\csv\vent_block.csv")
vent_block = Python()  # unwired: IN[0]
# ---------- vent_block.python (117 lines) ----------
import sys
import clr
# import Revit API
clr.AddReference('RevitAPI')
from Autodesk.Revit.DB import *
# import Revit API UI
clr.AddReference('RevitAPIUI')
# import Revit Services
clr.AddReference('RevitServices')
import RevitServices
from RevitServices.Persistence import DocumentManager
from RevitServices.Transactions import TransactionManager 
# import ProtoGeometry 
clr.AddReference('ProtoGeometry')
from Autodesk.DesignScript.Geometry import *
# get the current Revit Document 
doc = DocumentManager.Instance.CurrentDBDocument
# get the current Revit application
app = DocumentManager.Instance.CurrentUIApplication.Application
# get the current UI application
uiapp = DocumentManager.Instance.CurrentUIApplication
app = uiapp.Application


list_categories = FilteredElementCollector(doc).OfCategory(BuiltInCategory.OST_Columns).WhereElementIsNotElementType().ToElements()

list1 = []
list2 = []
list3 = []
list4 = []
list5 = []
list6 = []
list7 = []
list8 = []
list9 = []
list10 = []
list11 = []
list12 = []
list13 = []
list14 = []
list15 = []

for p in list_categories:
	typeId = p.GetTypeId()
	type = doc.GetElement(typeId)
	try:
		a = p.Id
	except:
		a = 0
	list1.append(a)
	try:
		b = p.UniqueId
	except:
		b = 0
	list2.append(b)
	try:
		c = p.LookupParameter("Navisworks").AsString()
	except:
		c = 0
	list3.append(c)
	try:
		d = p.LookupParameter("Уровень").AsValueString()
	except:
		d = 0
	list4.append(d)
	try:
		e = p.LookupParameter("Номер секции №").AsString()
	except:
		e = 0
	list5.append(e)
	try:
		f = p.LookupParameter("Категория").AsValueString()
	except:
		f = 0
	list6.append(f)
	try:
		g = p.Name
	except:
		g = 0
	list8.append(g)
	try:
		h = p.LookupParameter("Длина").AsValueString()
	except:
		h = 0
	list9.append(h)
	try:
		i = p.LookupParameter("Площадь").AsValueString()
	except:
		i = 0
	list10.append(i)
	try:
		j = p.LookupParameter("Объем").AsValueString()
	except:
		j = 0
	list11.append(j)
	try:
		k = p.LookupParameter("Смещение снизу").AsValueString()
	except:
		k = 0
	list12.append(k)
	try:
		l = p.LookupParameter("Смещение сверху").AsValueString()
	except:
		l = 0
	list13.append(l)
	try:
		o = p.Symbol.LookupParameter("Ширина").AsDouble()
	except:
		o = 0
	list14.append(str(o))
	try:
		w = p.Symbol.LookupParameter("Высота").AsDouble()
	except:
		w = 0
	list15.append(str(w))
	list7.append(type)
OUT = list1, list2, list3, list4, list5, list6, list7, list8, list9, list10, list11, list12, list13, list14, list15
# ----------------------------------------
code_block_3 = CodeBlock(a=vent_block) { a[0]; a[2]; a[2]; a[3]; a[4]; a[5]; a[6]; a[7]; a[8]; a[9]; a[10]; a[11]; a[12]; a[13]; a[14]; }
create_3 = List.Create(code_block_3.out0, code_block_3.out1, code_block_3.out2, code_block_3.out3, code_block_3.out4, code_block_3.out5, code_block_3.out6, code_block_3.out7, code_block_3.out8, code_block_3.out9, code_block_3.out10, code_block_3.out11, code_block_3.out12, code_block_3.out13, code_block_3.out14)
transpose_3 = List.Transpose(create_3)
writeToFile_3 = CSV.WriteToFile(file_path_3, transpose_3)
file_path_4 = Filename("..\csv\pandus.csv")
ramps = Python()  # unwired: IN[0]
# ---------- ramps.python (117 lines) ----------
import sys
import clr
# import Revit API
clr.AddReference('RevitAPI')
from Autodesk.Revit.DB import *
# import Revit API UI
clr.AddReference('RevitAPIUI')
# import Revit Services
clr.AddReference('RevitServices')
import RevitServices
from RevitServices.Persistence import DocumentManager
from RevitServices.Transactions import TransactionManager 
# import ProtoGeometry 
clr.AddReference('ProtoGeometry')
from Autodesk.DesignScript.Geometry import *
# get the current Revit Document 
doc = DocumentManager.Instance.CurrentDBDocument
# get the current Revit application
app = DocumentManager.Instance.CurrentUIApplication.Application
# get the current UI application
uiapp = DocumentManager.Instance.CurrentUIApplication
app = uiapp.Application


list_categories = FilteredElementCollector(doc).OfCategory(BuiltInCategory.OST_Ramps).WhereElementIsNotElementType().ToElements()

list1 = []
list2 = []
list3 = []
list4 = []
list5 = []
list6 = []
list7 = []
list8 = []
list9 = []
list10 = []
list11 = []
list12 = []
list13 = []
list14 = []
list15 = []

for p in list_categories:
	typeId = p.GetTypeId()
	type = doc.GetElement(typeId)
	try:
		a = p.Id
	except:
		a = 0
	list1.append(a)
	try:
		b = p.UniqueId
	except:
		b = 0
	list2.append(b)
	try:
		c = p.LookupParameter("Navisworks").AsString()
	except:
		c = 0
	list3.append(c)
	try:
		d = p.LookupParameter("Уровень").AsValueString()
	except:
		d = 0
	list4.append(d)
	try:
		e = p.LookupParameter("Номер секции №").AsString()
	except:
		e = 0
	list5.append(e)
	try:
		f = p.LookupParameter("Категория").AsValueString()
	except:
		f = 0
	list6.append(f)
	try:
		g = p.Name
	except:
		g = 0
	list8.append(g)
	try:
		h = p.LookupParameter("Длина").AsValueString()
	except:
		h = 0
	list9.append(h)
	try:
		i = p.LookupParameter("Площадь").AsValueString()
	except:
		i = 0
	list10.append(i)
	try:
		j = p.LookupParameter("Объем").AsValueString()
	except:
		j = 0
	list11.append(j)
	try:
		k = p.LookupParameter("Смещение снизу").AsValueString()
	except:
		k = 0
	list12.append(k)
	try:
		l = p.LookupParameter("Смещение сверху").AsValueString()
	except:
		l = 0
	list13.append(l)
	try:
		o = p.Symbol.LookupParameter("Ширина").AsDouble()
	except:
		o = 0
	list14.append(str(o))
	try:
		w = p.Symbol.LookupParameter("Высота").AsDouble()
	except:
		w = 0
	list15.append(str(w))
	list7.append(type)
OUT = list1, list2, list3, list4, list5, list6, list7, list8, list9, list10, list11, list12, list13, list14, list15
# ----------------------------------------
code_block_4 = CodeBlock(a=ramps) { a[0]; a[1]; a[2]; a[3]; a[4]; a[5]; a[6]; a[7]; a[8]; a[9]; a[10]; a[11]; a[12]; a[13]; a[14]; }
create_4 = List.Create(code_block_4.out0, code_block_4.out1, code_block_4.out2, code_block_4.out3, code_block_4.out4, code_block_4.out5, code_block_4.out6, code_block_4.out7, code_block_4.out8, code_block_4.out9, code_block_4.out10, code_block_4.out11, code_block_4.out12, code_block_4.out13, code_block_4.out14)
transpose_4 = List.Transpose(create_4)
writeToFile_4 = CSV.WriteToFile(file_path_4, transpose_4)
file_path_5 = Filename("..\csv\kolonna.csv")
columns = Python()  # unwired: IN[0]
# ---------- columns.python (118 lines) ----------
import sys
import clr
# import Revit API
clr.AddReference('RevitAPI')
from Autodesk.Revit.DB import *
# import Revit API UI
clr.AddReference('RevitAPIUI')
# import Revit Services
clr.AddReference('RevitServices')
import RevitServices
from RevitServices.Persistence import DocumentManager
from RevitServices.Transactions import TransactionManager 
# import ProtoGeometry 
clr.AddReference('ProtoGeometry')
from Autodesk.DesignScript.Geometry import *
# get the current Revit Document 
doc = DocumentManager.Instance.CurrentDBDocument
# get the current Revit application
app = DocumentManager.Instance.CurrentUIApplication.Application
# get the current UI application
uiapp = DocumentManager.Instance.CurrentUIApplication
app = uiapp.Application


list_categories = FilteredElementCollector(doc).OfCategory(BuiltInCategory.OST_StructuralColumns).WhereElementIsNotElementType().ToElements()


list1 = []
list2 = []
list3 = []
list4 = []
list5 = []
list6 = []
list7 = []
list8 = []
list9 = []
list10 = []
list11 = []
list12 = []
list13 = []
list14 = []
list15 = []

for p in list_categories:
	typeId = p.GetTypeId()
	type = doc.GetElement(typeId)
	try:
		a = p.Id
	except:
		a = 0
	list1.append(a)
	try:
		b = p.UniqueId
	except:
		b = 0
	list2.append(b)
	try:
		c = p.LookupParameter("Navisworks").AsString()
	except:
		c = 0
	list3.append(c)
	try:
		d = p.LookupParameter("Уровень").AsValueString()
	except:
		d = 0
	list4.append(d)
	try:
		e = p.LookupParameter("Номер секции №").AsString()
	except:
		e = 0
	list5.append(e)
	try:
		f = p.LookupParameter("Категория").AsValueString()
	except:
		f = 0
	list6.append(f)
	try:
		g = p.Name
	except:
		g = 0
	list8.append(g)
	try:
		h = p.LookupParameter("Длина").AsValueString()
	except:
		h = 0
	list9.append(h)
	try:
		i = p.LookupParameter("Площадь").AsValueString()
	except:
		i = 0
	list10.append(i)
	try:
		j = p.LookupParameter("Объем").AsValueString()
	except:
		j = 0
	list11.append(j)
	try:
		k = p.LookupParameter("Смещение снизу").AsValueString()
	except:
		k = 0
	list12.append(k)
	try:
		l = p.LookupParameter("Смещение сверху").AsValueString()
	except:
		l = 0
	list13.append(l)
	try:
		o = p.Symbol.LookupParameter("Ширина").AsDouble()
	except:
		o = 0
	list14.append(str(o))
	try:
		w = p.Symbol.LookupParameter("Высота").AsDouble()
	except:
		w = 0
	list15.append(str(w))
	list7.append(type)
OUT = list1, list2, list3, list4, list5, list6, list7, list8, list9, list10, list11, list12, list13, list14, list15
# ----------------------------------------
code_block_5 = CodeBlock(a=columns) { a[0]; a[1]; a[2]; a[3]; a[4]; a[5]; a[6]; a[7]; a[8]; a[9]; a[10]; a[11]; a[12]; a[13]; a[14]; }
create_5 = List.Create(code_block_5.out0, code_block_5.out1, code_block_5.out2, code_block_5.out3, code_block_5.out4, code_block_5.out5, code_block_5.out6, code_block_5.out7, code_block_5.out8, code_block_5.out9, code_block_5.out10, code_block_5.out11, code_block_5.out12, code_block_5.out13, code_block_5.out14)
transpose_5 = List.Transpose(create_5)
writeToFile_5 = CSV.WriteToFile(file_path_5, transpose_5)
file_path_6 = Filename("..\csv\door.csv")
doors = Python()
# ---------- doors.python (117 lines) ----------
import sys
import clr
# import Revit API
clr.AddReference('RevitAPI')
from Autodesk.Revit.DB import *
# import Revit API UI
clr.AddReference('RevitAPIUI')
# import Revit Services
clr.AddReference('RevitServices')
import RevitServices
from RevitServices.Persistence import DocumentManager
from RevitServices.Transactions import TransactionManager 
# import ProtoGeometry 
clr.AddReference('ProtoGeometry')
from Autodesk.DesignScript.Geometry import *
# get the current Revit Document 
doc = DocumentManager.Instance.CurrentDBDocument
# get the current Revit application
app = DocumentManager.Instance.CurrentUIApplication.Application
# get the current UI application
uiapp = DocumentManager.Instance.CurrentUIApplication
app = uiapp.Application


list_categories = FilteredElementCollector(doc).OfCategory(BuiltInCategory.OST_Doors).WhereElementIsNotElementType().ToElements()

list1 = []
list2 = []
list3 = []
list4 = []
list5 = []
list6 = []
list7 = []
list8 = []
list9 = []
list10 = []
list11 = []
list12 = []
list13 = []
list14 = []
list15 = []

for p in list_categories:
	typeId = p.GetTypeId()
	type = doc.GetElement(typeId)
	try:
		a = p.Id
	except:
		a = 0
	list1.append(a)
	try:
		b = p.UniqueId
	except:
		b = 0
	list2.append(b)
	try:
		c = p.LookupParameter("Navisworks").AsString()
	except:
		c = 0
	list3.append(c)
	try:
		d = p.LookupParameter("Уровень").AsValueString()
	except:
		d = 0
	list4.append(d)
	try:
		e = p.LookupParameter("Номер секции №").AsString()
	except:
		e = 0
	list5.append(e)
	try:
		f = p.LookupParameter("Категория").AsValueString()
	except:
		f = 0
	list6.append(f)
	try:
		g = p.Name
	except:
		g = 0
	list8.append(g)
	try:
		h = p.LookupParameter("Длина").AsValueString()
	except:
		h = 0
	list9.append(h)
	try:
		i = p.LookupParameter("Площадь").AsValueString()
	except:
		i = 0
	list10.append(i)
	try:
		j = p.LookupParameter("Объем").AsValueString()
	except:
		j = 0
	list11.append(j)
	try:
		k = p.LookupParameter("Смещение снизу").AsValueString()
	except:
		k = 0
	list12.append(k)
	try:
		l = p.LookupParameter("Смещение сверху").AsValueString()
	except:
		l = 0
	list13.append(l)
	try:
		o = p.Symbol.LookupParameter("Ширина").AsDouble()
	except:
		o = 0
	list14.append(str(o))
	try:
		w = p.Symbol.LookupParameter("Высота").AsDouble()
	except:
		w = 0
	list15.append(str(w))
	list7.append(type)
OUT = list1, list2, list3, list4, list5, list6, list7, list8, list9, list10, list11, list12, list13, list14, list15
# ----------------------------------------
code_block_6 = CodeBlock(a=doors) { a[0]; a[1]; a[2]; a[3]; a[4]; a[5]; a[6]; a[7]; a[8]; a[9]; a[10]; a[11]; a[12]; a[13]; a[14]; }
create_6 = List.Create(code_block_6.out0, code_block_6.out1, code_block_6.out2, code_block_6.out3, code_block_6.out4, code_block_6.out5, code_block_6.out6, code_block_6.out7, code_block_6.out8, code_block_6.out9, code_block_6.out10, code_block_6.out11, code_block_6.out12, code_block_6.out13, code_block_6.out14)
transpose_6 = List.Transpose(create_6)
writeToFile_6 = CSV.WriteToFile(file_path_6, transpose_6)
file_path_7 = Filename("..\csv\perek_csv.csv")
floors = Python()  # unwired: IN[0]
# ---------- floors.python (117 lines) ----------
import sys
import clr
# import Revit API
clr.AddReference('RevitAPI')
from Autodesk.Revit.DB import *
# import Revit API UI
clr.AddReference('RevitAPIUI')
# import Revit Services
clr.AddReference('RevitServices')
import RevitServices
from RevitServices.Persistence import DocumentManager
from RevitServices.Transactions import TransactionManager 
# import ProtoGeometry 
clr.AddReference('ProtoGeometry')
from Autodesk.DesignScript.Geometry import *
# get the current Revit Document 
doc = DocumentManager.Instance.CurrentDBDocument
# get the current Revit application
app = DocumentManager.Instance.CurrentUIApplication.Application
# get the current UI application
uiapp = DocumentManager.Instance.CurrentUIApplication
app = uiapp.Application


list_categories = FilteredElementCollector(doc).OfCategory(BuiltInCategory.OST_Floors).WhereElementIsNotElementType().ToElements()

list1 = []
list2 = []
list3 = []
list4 = []
list5 = []
list6 = []
list7 = []
list8 = []
list9 = []
list10 = []
list11 = []
list12 = []
list13 = []
list14 = []
list15 = []

for p in list_categories:
	typeId = p.GetTypeId()
	type = doc.GetElement(typeId)
	try:
		a = p.Id
	except:
		a = 0
	list1.append(a)
	try:
		b = p.UniqueId
	except:
		b = 0
	list2.append(b)
	try:
		c = p.LookupParameter("Navisworks").AsString()
	except:
		c = 0
	list3.append(c)
	try:
		d = p.LookupParameter("Уровень").AsValueString()
	except:
		d = 0
	list4.append(d)
	try:
		e = p.LookupParameter("Номер секции №").AsString()
	except:
		e = 0
	list5.append(e)
	try:
		f = p.LookupParameter("Категория").AsValueString()
	except:
		f = 0
	list6.append(f)
	try:
		g = p.Name
	except:
		g = 0
	list8.append(g)
	try:
		h = p.LookupParameter("Длина").AsValueString()
	except:
		h = 0
	list9.append(h)
	try:
		i = p.LookupParameter("Площадь").AsValueString()
	except:
		i = 0
	list10.append(i)
	try:
		j = p.LookupParameter("Объем").AsValueString()
	except:
		j = 0
	list11.append(j)
	try:
		k = p.LookupParameter("Смещение снизу").AsValueString()
	except:
		k = 0
	list12.append(k)
	try:
		l = p.LookupParameter("Смещение сверху").AsValueString()
	except:
		l = 0
	list13.append(l)
	try:
		o = p.Symbol.LookupParameter("Ширина").AsDouble()
	except:
		o = 0
	list14.append(str(o))
	try:
		w = p.Symbol.LookupParameter("Высота").AsDouble()
	except:
		w = 0
	list15.append(str(w))
	list7.append(type)
OUT = list1, list2, list3, list4, list5, list6, list7, list8, list9, list10, list11, list12, list13, list14, list15
# ----------------------------------------
code_block_7 = CodeBlock(a=floors) { a[0]; a[1]; a[2]; a[3]; a[4]; a[5]; a[6]; a[7]; a[8]; a[9]; a[10]; a[11]; a[12]; a[13]; a[14]; }
create_7 = List.Create(code_block_7.out0, code_block_7.out1, code_block_7.out2, code_block_7.out3, code_block_7.out4, code_block_7.out5, code_block_7.out6, code_block_7.out7, code_block_7.out8, code_block_7.out9, code_block_7.out10, code_block_7.out11, code_block_7.out12, code_block_7.out13, code_block_7.out14)
transpose_7 = List.Transpose(create_7)
writeToFile_7 = CSV.WriteToFile(file_path_7, transpose_7)
file_path_8 = Filename("..\csv\spec_csv.csv")
specialityEquipment = Python()  # unwired: IN[0]
# ---------- specialityEquipment.python (117 lines) ----------
import sys
import clr
# import Revit API
clr.AddReference('RevitAPI')
from Autodesk.Revit.DB import *
# import Revit API UI
clr.AddReference('RevitAPIUI')
# import Revit Services
clr.AddReference('RevitServices')
import RevitServices
from RevitServices.Persistence import DocumentManager
from RevitServices.Transactions import TransactionManager 
# import ProtoGeometry 
clr.AddReference('ProtoGeometry')
from Autodesk.DesignScript.Geometry import *
# get the current Revit Document 
doc = DocumentManager.Instance.CurrentDBDocument
# get the current Revit application
app = DocumentManager.Instance.CurrentUIApplication.Application
# get the current UI application
uiapp = DocumentManager.Instance.CurrentUIApplication
app = uiapp.Application


list_categories = FilteredElementCollector(doc).OfCategory(BuiltInCategory.OST_SpecialityEquipment).WhereElementIsNotElementType().ToElements()

list1 = []
list2 = []
list3 = []
list4 = []
list5 = []
list6 = []
list7 = []
list8 = []
list9 = []
list10 = []
list11 = []
list12 = []
list13 = []
list14 = []
list15 = []

for p in list_categories:
	typeId = p.GetTypeId()
	type = doc.GetElement(typeId)
	try:
		a = p.Id
	except:
		a = 0
	list1.append(a)
	try:
		b = p.UniqueId
	except:
		b = 0
	list2.append(b)
	try:
		c = p.LookupParameter("Navisworks").AsString()
	except:
		c = 0
	list3.append(c)
	try:
		d = p.LookupParameter("Уровень").AsValueString()
	except:
		d = 0
	list4.append(d)
	try:
		e = p.LookupParameter("Номер секции №").AsString()
	except:
		e = 0
	list5.append(e)
	try:
		f = p.LookupParameter("Категория").AsValueString()
	except:
		f = 0
	list6.append(f)
	try:
		g = p.Name
	except:
		g = 0
	list8.append(g)
	try:
		h = p.LookupParameter("Длина").AsValueString()
	except:
		h = 0
	list9.append(h)
	try:
		i = p.LookupParameter("Площадь").AsValueString()
	except:
		i = 0
	list10.append(i)
	try:
		j = p.LookupParameter("Объем").AsValueString()
	except:
		j = 0
	list11.append(j)
	try:
		k = p.LookupParameter("Смещение снизу").AsValueString()
	except:
		k = 0
	list12.append(k)
	try:
		l = p.LookupParameter("Смещение сверху").AsValueString()
	except:
		l = 0
	list13.append(l)
	try:
		o = p.Symbol.LookupParameter("Ширина").AsDouble()
	except:
		o = 0
	list14.append(str(o))
	try:
		w = p.Symbol.LookupParameter("Высота").AsDouble()
	except:
		w = 0
	list15.append(str(w))
	list7.append(type)
OUT = list1, list2, list3, list4, list5, list6, list7, list8, list9, list10, list11, list12, list13, list14, list15
# ----------------------------------------
code_block_8 = CodeBlock(a=specialityEquipment) { a[0]; a[1]; a[2]; a[3]; a[4]; a[5]; a[6]; a[7]; a[8]; a[9]; a[10]; a[11]; a[12]; a[13]; a[14]; }
create_8 = List.Create(code_block_8.out0, code_block_8.out1, code_block_8.out2, code_block_8.out3, code_block_8.out4, code_block_8.out5, code_block_8.out6, code_block_8.out7, code_block_8.out8, code_block_8.out9, code_block_8.out10, code_block_8.out11, code_block_8.out12, code_block_8.out13, code_block_8.out14)
transpose_8 = List.Transpose(create_8)
writeToFile_8 = CSV.WriteToFile(file_path_8, transpose_8)
file_path_9 = Filename("..\csv\stairs.csv")
stairs = Python()  # unwired: IN[0]
# ---------- stairs.python (117 lines) ----------
import sys
import clr
# import Revit API
clr.AddReference('RevitAPI')
from Autodesk.Revit.DB import *
# import Revit API UI
clr.AddReference('RevitAPIUI')
# import Revit Services
clr.AddReference('RevitServices')
import RevitServices
from RevitServices.Persistence import DocumentManager
from RevitServices.Transactions import TransactionManager 
# import ProtoGeometry 
clr.AddReference('ProtoGeometry')
from Autodesk.DesignScript.Geometry import *
# get the current Revit Document 
doc = DocumentManager.Instance.CurrentDBDocument
# get the current Revit application
app = DocumentManager.Instance.CurrentUIApplication.Application
# get the current UI application
uiapp = DocumentManager.Instance.CurrentUIApplication
app = uiapp.Application


list_categories = FilteredElementCollector(doc).OfCategory(BuiltInCategory.OST_Stairs).WhereElementIsNotElementType().ToElements()

list1 = []
list2 = []
list3 = []
list4 = []
list5 = []
list6 = []
list7 = []
list8 = []
list9 = []
list10 = []
list11 = []
list12 = []
list13 = []
list14 = []
list15 = []

for p in list_categories:
	typeId = p.GetTypeId()
	type = doc.GetElement(typeId)
	try:
		a = p.Id
	except:
		a = 0
	list1.append(a)
	try:
		b = p.UniqueId
	except:
		b = 0
	list2.append(b)
	try:
		c = p.LookupParameter("Navisworks").AsString()
	except:
		c = 0
	list3.append(c)
	try:
		d = p.LookupParameter("Базовый уровень").AsValueString()
	except:
		d = 0
	list4.append(d)
	try:
		e = p.LookupParameter("Номер секции №").AsString()
	except:
		e = 0
	list5.append(e)
	try:
		f = p.LookupParameter("Категория").AsValueString()
	except:
		f = 0
	list6.append(f)
	try:
		g = p.Name
	except:
		g = 0
	list8.append(g)
	try:
		h = p.LookupParameter("Длина").AsValueString()
	except:
		h = 0
	list9.append(h)
	try:
		i = p.LookupParameter("Площадь").AsValueString()
	except:
		i = 0
	list10.append(i)
	try:
		j = p.LookupParameter("Объем").AsValueString()
	except:
		j = 0
	list11.append(j)
	try:
		k = p.LookupParameter("Смещение снизу").AsValueString()
	except:
		k = 0
	list12.append(k)
	try:
		l = p.LookupParameter("Смещение сверху").AsValueString()
	except:
		l = 0
	list13.append(l)
	try:
		o = p.Symbol.LookupParameter("Ширина").AsDouble()
	except:
		o = 0
	list14.append(str(o))
	try:
		w = p.Symbol.LookupParameter("Высота").AsDouble()
	except:
		w = 0
	list15.append(str(w))
	list7.append(type)
OUT = list1, list2, list3, list4, list5, list6, list7, list8, list9, list10, list11, list12, list13, list14, list15
# ----------------------------------------
code_block_9 = CodeBlock(a=stairs) { a[0]; a[1]; a[2]; a[3]; a[4]; a[5]; a[6]; a[7]; a[8]; a[9]; a[10]; a[11]; a[12]; a[13]; a[14]; }
create_9 = List.Create(code_block_9.out0, code_block_9.out1, code_block_9.out2, code_block_9.out3, code_block_9.out4, code_block_9.out5, code_block_9.out6, code_block_9.out7, code_block_9.out8, code_block_9.out9, code_block_9.out10, code_block_9.out11, code_block_9.out12, code_block_9.out13, code_block_9.out14)
transpose_9 = List.Transpose(create_9)
writeToFile_9 = CSV.WriteToFile(file_path_9, transpose_9)
file_path_10 = Filename("..\csv\marsh.csv")
genericmodel = Python()  # unwired: IN[0]
# ---------- genericmodel.python (117 lines) ----------
import sys
import clr
# import Revit API
clr.AddReference('RevitAPI')
from Autodesk.Revit.DB import *
# import Revit API UI
clr.AddReference('RevitAPIUI')
# import Revit Services
clr.AddReference('RevitServices')
import RevitServices
from RevitServices.Persistence import DocumentManager
from RevitServices.Transactions import TransactionManager 
# import ProtoGeometry 
clr.AddReference('ProtoGeometry')
from Autodesk.DesignScript.Geometry import *
# get the current Revit Document 
doc = DocumentManager.Instance.CurrentDBDocument
# get the current Revit application
app = DocumentManager.Instance.CurrentUIApplication.Application
# get the current UI application
uiapp = DocumentManager.Instance.CurrentUIApplication
app = uiapp.Application


list_categories = FilteredElementCollector(doc).OfCategory(BuiltInCategory.OST_GenericModel).WhereElementIsNotElementType().ToElements()

list1 = []
list2 = []
list3 = []
list4 = []
list5 = []
list6 = []
list7 = []
list8 = []
list9 = []
list10 = []
list11 = []
list12 = []
list13 = []
list14 = []
list15 = []

for p in list_categories:
	typeId = p.GetTypeId()
	type = doc.GetElement(typeId)
	try:
		a = p.Id
	except:
		a = 0
	list1.append(a)
	try:
		b = p.UniqueId
	except:
		b = 0
	list2.append(b)
	try:
		c = p.LookupParameter("Navisworks").AsString()
	except:
		c = 0
	list3.append(c)
	try:
		d = p.LookupParameter("Уровень").AsValueString()
	except:
		d = 0
	list4.append(d)
	try:
		e = p.LookupParameter("Номер секции №").AsString()
	except:
		e = 0
	list5.append(e)
	try:
		f = p.LookupParameter("Категория").AsValueString()
	except:
		f = 0
	list6.append(f)
	try:
		g = p.Name
	except:
		g = 0
	list8.append(g)
	try:
		h = p.LookupParameter("Длина").AsValueString()
	except:
		h = 0
	list9.append(h)
	try:
		i = p.LookupParameter("Площадь").AsValueString()
	except:
		i = 0
	list10.append(i)
	try:
		j = p.LookupParameter("Объем").AsValueString()
	except:
		j = 0
	list11.append(j)
	try:
		k = p.LookupParameter("Смещение снизу").AsValueString()
	except:
		k = 0
	list12.append(k)
	try:
		l = p.LookupParameter("Смещение сверху").AsValueString()
	except:
		l = 0
	list13.append(l)
	try:
		o = p.Symbol.LookupParameter("Ширина").AsDouble()
	except:
		o = 0
	list14.append(str(o))
	try:
		w = p.Symbol.LookupParameter("Высота").AsDouble()
	except:
		w = 0
	list15.append(str(w))
	list7.append(type)
OUT = list1, list2, list3, list4, list5, list6, list7, list8, list9, list10, list11, list12, list13, list14, list15
# ----------------------------------------
code_block_10 = CodeBlock(a=genericmodel) { a[0]; a[1]; a[2]; a[3]; a[4]; a[5]; a[6]; a[7]; a[8]; a[9]; a[10]; a[11]; a[12]; a[13]; a[14]; }
create_10 = List.Create(code_block_10.out0, code_block_10.out1, code_block_10.out2, code_block_10.out3, code_block_10.out4, code_block_10.out5, code_block_10.out6, code_block_10.out7, code_block_10.out8, code_block_10.out9, code_block_10.out10, code_block_10.out11, code_block_10.out12, code_block_10.out13, code_block_10.out14)
transpose_10 = List.Transpose(create_10)
writeToFile_10 = CSV.WriteToFile(file_path_10, transpose_10)
file_path_11 = Filename("..\excel\stairs.xls")
string = StringInput("Sheet")
number = DoubleInput(0)
writeToFile_11 = Excel.WriteToFile(filePath=file_path_11, sheetName=string, startRow=number, startCol=number, data=transpose_9)
string_2 = StringInput("")
file_path_12 = Filename("..\excel\special.xls")
string_3 = StringInput("Sheet")
number_2 = DoubleInput(0)
writeToFile_12 = Excel.WriteToFile(filePath=file_path_12, sheetName=string_3, startRow=number_2, startCol=number_2, data=transpose_8)
file_path_13 = Filename("..\excel\floors.xls")
string_4 = StringInput("Sheet")
number_3 = DoubleInput(0)
writeToFile_13 = Excel.WriteToFile(filePath=file_path_13, sheetName=string_4, startRow=number_3, startCol=number_3, data=transpose_7)
file_path_14 = Filename("..\excel\generic.xls")
string_5 = StringInput("Sheet")
number_4 = DoubleInput(0)
writeToFile_14 = Excel.WriteToFile(filePath=file_path_14, sheetName=string_5, startRow=number_4, startCol=number_4, data=transpose_10)
file_path_15 = Filename("..\excel\walls.xls")
string_6 = StringInput("Sheet")
number_5 = DoubleInput(0)
writeToFile_15 = Excel.WriteToFile(filePath=file_path_15, sheetName=string_6, startRow=number_5, startCol=number_5, data=transpose)
file_path_16 = Filename("..\excel\vent.xls")
string_7 = StringInput("Sheet")
number_6 = DoubleInput(0)
writeToFile_16 = Excel.WriteToFile(filePath=file_path_16, sheetName=string_7, startRow=number_6, startCol=number_6, data=transpose_3)
file_path_17 = Filename("..\excel\windows.xls")
string_8 = StringInput("Sheet")
number_7 = DoubleInput(0)
writeToFile_17 = Excel.WriteToFile(filePath=file_path_17, sheetName=string_8, startRow=number_7, startCol=number_7, data=transpose_2)
file_path_18 = Filename("..\excel\cooumns.xls")
string_9 = StringInput("Sheet")
number_8 = DoubleInput(0)
writeToFile_18 = Excel.WriteToFile(filePath=file_path_18, sheetName=string_9, startRow=number_8, startCol=number_8, data=transpose_5)
file_path_19 = Filename("..\excel\ramps.xls")
string_10 = StringInput("Sheet")
number_9 = DoubleInput(0)
writeToFile_19 = Excel.WriteToFile(filePath=file_path_19, sheetName=string_10, startRow=number_9, startCol=number_9, data=transpose_4)
file_path_20 = Filename("..\excel\doors.xls")
string_11 = StringInput("Sheet")
number_10 = DoubleInput(0)
writeToFile_20 = Excel.WriteToFile(filePath=file_path_20, sheetName=string_11, startRow=number_10, startCol=number_10, data=transpose_6)
