# Dynamo graph door.dyn (Dynamo 1.3.3.4111)

file_path = Filename("..\csv\door.csv")
doors = Python()  # unwired: IN[0]
# ---------- doors.python (82 lines) ----------
import sys
import clr
# import Revit API
clr.AddReference('RevitAPI')
from Autodesk.Revit.DB import *
# import Revit API UI
clr.AddReference('RevitAPIUI')
# import Revit Services
clr.AddReference('RevitServices')
import RevitServices
from RevitServices.Persistence import DocumentManager
from RevitServices.Transactions import TransactionManager 
# import ProtoGeometry 
clr.AddReference('ProtoGeometry')
from Autodesk.DesignScript.Geometry import *
# get the current Revit Document 
doc = DocumentManager.Instance.CurrentDBDocument
# get the current Revit application
app = DocumentManager.Instance.CurrentUIApplication.Application
# get the current UI application
uiapp = DocumentManager.Instance.CurrentUIApplication
app = uiapp.Application


list_d = FilteredElementCollector(doc).OfCategory(BuiltInCategory.OST_Doors).WhereElementIsNotElementType().ToElements()

list1 = []
list2 = []
list3 = []
list4 = []
list5 = []
list6 = []
list7 = []
list8 = []
list9 = []

for d in list_d:
	typeId = d.GetTypeId()
	type = doc.GetElement(typeId)
	try:
		a = d.Id
	except:
		a = 0
	list1.append(a)
	try:
		b = d.UniqueId
	except:
		b = 0
	list2.append(b)
	try:
		c = d.LookupParameter("Navisworks").AsString()
	except:
		c = 0
	list3.append(c)
	try:
		y = d.LookupParameter("Уровень").AsValueString()
	except:
		y = 0
	list4.append(y)
	try:
		e = d.LookupParameter("Номер секции №").AsString()
	except:
		e = 0
	list5.append(e)
	try:
		f = d.LookupParameter("Категория").AsValueString()
	except:
		f = 0
	list6.append(f)
	list7.append(type)
	try:
		g = d.Name
	except:
		g = 0
	list8.append(g)
	try:
		k = d.LookupParameter("Марка").AsString()
	except:
		k = 0
	list9.append(k)

OUT = list1, list2, list3, list4, list5, list6, list7, list8, list9
# ----------------------------------------
code_block = CodeBlock(a=doors) { a[0]; a[1]; a[2]; a[3]; a[4]; a[5]; a[6]; a[7]; a[8]; }
create = List.Create(code_block.out0, code_block.out1, code_block.out2, code_block.out3, code_block.out4, code_block.out5, code_block.out6, code_block.out7, code_block.out8)
transpose = List.Transpose(create)
writeToFile = CSV.WriteToFile(file_path, transpose)
