# Dynamo graph pandus.dyn (Dynamo 1.3.3.4111)

file_path = Filename("C:\Users\andre\Desktop\Проект\csv\pandus.csv")
palms = Python()  # unwired: IN[0]
# ---------- palms.python (82 lines) ----------
import sys
import clr
# import Revit API
clr.AddReference('RevitAPI')
from Autodesk.Revit.DB import *
# import Revit API UI
clr.AddReference('RevitAPIUI')
# import Revit Services
clr.AddReference('RevitServices')
import RevitServices
from RevitServices.Persistence import DocumentManager
from RevitServices.Transactions import TransactionManager 
# import ProtoGeometry 
clr.AddReference('ProtoGeometry')
from Autodesk.DesignScript.Geometry import *
# get the current Revit Document 
doc = DocumentManager.Instance.CurrentDBDocument
# get the current Revit application
app = DocumentManager.Instance.CurrentUIApplication.Application
# get the current UI application
uiapp = DocumentManager.Instance.CurrentUIApplication
app = uiapp.Application


list_p = FilteredElementCollector(doc).OfCategory(BuiltInCategory.OST_Ramps).WhereElementIsNotElementType().ToElements()

list1 = []
list2 = []
list3 = []
list4 = []
list5 = []
list6 = []
list7 = []
list8 = []


for p in list_p:
	typeId = p.GetTypeId()
	type = doc.GetElement(typeId)
	try:
		a = p.Id
	except:
		a = 0
	list1.append(a)
	try:
		b = p.UniqueId
	except:
		b = 0
	list2.append(b)
	try:
		c = p.LookupParameter("Navisworks").AsString()
	except:
		c = 0
	list3.append(c)
	try:
		d = p.LookupParameter("Уровень").AsValueString()
	except:
		d = 0
	list4.append(d)
	try:
		e = p.LookupParameter("Номер секции №").AsString()
	except:
		e = 0
	list5.append(e)
	try:
		f = p.LookupParameter("Категория").AsValueString()
	except:
		f = 0
	list6.append(f)
	try:
		g = p.Name
	except:
		g = 0
	list7.append(g)
	try:
		i = p.LookupParameter("Ширина").AsDouble()
	except:
		i = 0
	list8.append(i)
	
	
OUT = list1, list2, list3, list4, list5, list6, list7, list8
# ----------------------------------------
code_block = CodeBlock(a=palms) { a[0]; a[1]; a[2]; a[3]; a[4]; a[5]; a[6]; a[7]; }
create = List.Create(code_block.out0, code_block.out1, code_block.out2, code_block.out3, code_block.out4, code_block.out5, code_block.out6, code_block.out7)
transpose = List.Transpose(create)
writeToFile = CSV.WriteToFile(file_path, transpose)
