# Dynamo graph perekritie.dyn (Dynamo 1.3.3.4111)

file_path = Filename("C:\Users\andre\Desktop\Проект\csv\perek_csv.csv")
categories = Categories("Floors")
all_elements_of_category = ElementsOfCategory(categories)
id = Python(IN[0]=all_elements_of_category)
# ---------- id.python (34 lines) ----------
import sys
import clr
# import Revit API
clr.AddReference('RevitAPI')
from Autodesk.Revit.DB import *
# import Revit API UI
clr.AddReference('RevitAPIUI')
# import Revit Services
clr.AddReference('RevitServices')
import RevitServices
from RevitServices.Persistence import DocumentManager
from RevitServices.Transactions import TransactionManager 
# import ProtoGeometry 
clr.AddReference('ProtoGeometry')
from Autodesk.DesignScript.Geometry import *
# get the current Revit Document 
doc = DocumentManager.Instance.CurrentDBDocument
# get the current Revit application
app = DocumentManager.Instance.CurrentUIApplication.Application
# get the current UI application
uiapp = DocumentManager.Instance.CurrentUIApplication
app = uiapp.Application


list_perec= UnwrapElement(IN[0])
list1 = []

for i in list_perec:
	typeId = i.GetTypeId()
	type = doc.GetElement(typeId)
	a = i.Id
	list1.append(a)

OUT = list1
# ----------------------------------------
uniqueId = Python(IN[0]=all_elements_of_category)
# ---------- uniqueId.python (34 lines) ----------
import sys
import clr
# import Revit API
clr.AddReference('RevitAPI')
from Autodesk.Revit.DB import *
# import Revit API UI
clr.AddReference('RevitAPIUI')
# import Revit Services
clr.AddReference('RevitServices')
import RevitServices
from RevitServices.Persistence import DocumentManager
from RevitServices.Transactions import TransactionManager 
# import ProtoGeometry 
clr.AddReference('ProtoGeometry')
from Autodesk.DesignScript.Geometry import *
# get the current Revit Document 
doc = DocumentManager.Instance.CurrentDBDocument
# get the current Revit application
app = DocumentManager.Instance.CurrentUIApplication.Application
# get the current UI application
uiapp = DocumentManager.Instance.CurrentUIApplication
app = uiapp.Application


list_perec= UnwrapElement(IN[0])
list1 = []

for i in list_perec:
	typeId = i.GetTypeId()
	type = doc.GetElement(typeId)
	a = i.UniqueId
	list1.append(a)

OUT = list1
# ----------------------------------------
navisworks = Python(IN[0]=all_elements_of_category)
# ---------- navisworks.python (34 lines) ----------
import sys
import clr
# import Revit API
clr.AddReference('RevitAPI')
from Autodesk.Revit.DB import *
# import Revit API UI
clr.AddReference('RevitAPIUI')
# import Revit Services
clr.AddReference('RevitServices')
import RevitServices
from RevitServices.Persistence import DocumentManager
from RevitServices.Transactions import TransactionManager 
# import ProtoGeometry 
clr.AddReference('ProtoGeometry')
from Autodesk.DesignScript.Geometry import *
# get the current Revit Document 
doc = DocumentManager.Instance.CurrentDBDocument
# get the current Revit application
app = DocumentManager.Instance.CurrentUIApplication.Application
# get the current UI application
uiapp = DocumentManager.Instance.CurrentUIApplication
app = uiapp.Application


list_perec= UnwrapElement(IN[0])
list1 = []

for i in list_perec:
	typeId = i.GetTypeId()
	type = doc.GetElement(typeId)
	a = i.LookupParameter("Navisworks").AsString()
	list1.append(a)

OUT = list1
# ----------------------------------------
уровень = Python(IN[0]=all_elements_of_category)
# ---------- уровень.python (34 lines) ----------
import sys
import clr
# import Revit API
clr.AddReference('RevitAPI')
from Autodesk.Revit.DB import *
# import Revit API UI
clr.AddReference('RevitAPIUI')
# import Revit Services
clr.AddReference('RevitServices')
import RevitServices
from RevitServices.Persistence import DocumentManager
from RevitServices.Transactions import TransactionManager 
# import ProtoGeometry 
clr.AddReference('ProtoGeometry')
from Autodesk.DesignScript.Geometry import *
# get the current Revit Document 
doc = DocumentManager.Instance.CurrentDBDocument
# get the current Revit application
app = DocumentManager.Instance.CurrentUIApplication.Application
# get the current UI application
uiapp = DocumentManager.Instance.CurrentUIApplication
app = uiapp.Application


list_perec= UnwrapElement(IN[0])
list1 = []

for i in list_perec:
	typeId = i.GetTypeId()
	type = doc.GetElement(typeId)
	a = i.LookupParameter("Уровень").AsValueString()
	list1.append(a)

OUT = list1
# ----------------------------------------
номер_секции = Python(IN[0]=all_elements_of_category)
# ---------- номер_секции.python (34 lines) ----------
import sys
import clr
# import Revit API
clr.AddReference('RevitAPI')
from Autodesk.Revit.DB import *
# import Revit API UI
clr.AddReference('RevitAPIUI')
# import Revit Services
clr.AddReference('RevitServices')
import RevitServices
from RevitServices.Persistence import DocumentManager
from RevitServices.Transactions import TransactionManager 
# import ProtoGeometry 
clr.AddReference('ProtoGeometry')
from Autodesk.DesignScript.Geometry import *
# get the current Revit Document 
doc = DocumentManager.Instance.CurrentDBDocument
# get the current Revit application
app = DocumentManager.Instance.CurrentUIApplication.Application
# get the current UI application
uiapp = DocumentManager.Instance.CurrentUIApplication
app = uiapp.Application


list_perec= UnwrapElement(IN[0])
list1 = []

for i in list_perec:
	typeId = i.GetTypeId()
	type = doc.GetElement(typeId)
	a = i.LookupParameter("Номер секции №").AsString()
	list1.append(a)

OUT = list1
# ----------------------------------------
string = StringInput("Категория")
категория = Element.GetParameterValueByName(element=all_elements_of_category, parameterName=string)
name = Python(IN[0]=all_elements_of_category)
# ---------- name.python (34 lines) ----------
import sys
import clr
# import Revit API
clr.AddReference('RevitAPI')
from Autodesk.Revit.DB import *
# import Revit API UI
clr.AddReference('RevitAPIUI')
# import Revit Services
clr.AddReference('RevitServices')
import RevitServices
from RevitServices.Persistence import DocumentManager
from RevitServices.Transactions import TransactionManager 
# import ProtoGeometry 
clr.AddReference('ProtoGeometry')
from Autodesk.DesignScript.Geometry import *
# get the current Revit Document 
doc = DocumentManager.Instance.CurrentDBDocument
# get the current Revit application
app = DocumentManager.Instance.CurrentUIApplication.Application
# get the current UI application
uiapp = DocumentManager.Instance.CurrentUIApplication
app = uiapp.Application


list_perec= UnwrapElement(IN[0])
list1 = []

for i in list_perec:
	typeId = i.GetTypeId()
	type = doc.GetElement(typeId)
	a = i.Name
	list1.append(a)

OUT = list1
# ----------------------------------------
create = List.Create(id, uniqueId, navisworks, уровень, номер_секции, категория, name)
transpose = List.Transpose(create)
writeToFile = CSV.WriteToFile(file_path, transpose)
