# Dynamo graph stairs.dyn (Dynamo 1.3.3.4111)

file_path = Filename(".\stairs.csv")
stairs = Python()  # unwired: IN[0]
# ---------- stairs.python (85 lines) ----------
import sys
import clr
# import Revit API
clr.AddReference('RevitAPI')
from Autodesk.Revit.DB import *
# import Revit API UI
clr.AddReference('RevitAPIUI')
# import Revit Services
clr.AddReference('RevitServices')
import RevitServices
from RevitServices.Persistence import DocumentManager
from RevitServices.Transactions import TransactionManager 
# import ProtoGeometry 
clr.AddReference('ProtoGeometry')
from Autodesk.DesignScript.Geometry import *
# get the current Revit Document 
doc = DocumentManager.Instance.CurrentDBDocument
# get the current Revit application
app = DocumentManager.Instance.CurrentUIApplication.Application
# get the current UI application
uiapp = DocumentManager.Instance.CurrentUIApplication
app = uiapp.Application


list_stairs = FilteredElementCollector(doc).OfCategory(BuiltInCategory.OST_Stairs).WhereElementIsNotElementType().ToElements()

list1 = []
list2 = []
list3 = []
list4 = []
list5 = []
list6 = []
list7 = []
list8 = []
list9 = []


for s in list_stairs:
	typeId = s.GetTypeId()
	type = doc.GetElement(typeId)
	try:
		a = s.Id
	except:
		a = 0
	list1.append(a)
	try:
		b = s.UniqueId
	except:
		b = 0
	list2.append(b)
	try:
		c = s.LookupParameter("Navisworks").AsString()
	except:
		c = 0
	list3.append(c)
	try:
		d = s.LookupParameter("Уровень").AsValueString()
	except:
		d = 0
	list4.append(d)
	try:
		e = s.LookupParameter("Номер секции №").AsString()
	except:
		e = 0
	list5.append(e)
	try:
		f = s.LookupParameter("Категория").AsValueString()
	except:
		f = 0
	list6.append(f)
	list7.append(type)
	try:
		g = s.Name
	except:
		g = 0
	list8.append(g)
	try:
		i = s.LookupParameter("Объем").AsValueString()
	except:
		i = 0
	list9.append(i)


	
OUT = list1, list2, list3, list4, list5, list6, list7, list8, list9
# ----------------------------------------
code_block = CodeBlock(a=stairs) { a[0]; a[1]; a[2]; a[3]; a[4]; a[5]; a[6]; a[7]; a[8]; }
create = List.Create(code_block.out0, code_block.out1, code_block.out2, code_block.out3, code_block.out4, code_block.out5, code_block.out6, code_block.out7, code_block.out8)
writeToFile = CSV.WriteToFile(file_path, create)
