# Dynamo graph to_csv_test.dyn (Dynamo 1.3.3.4111)

file_path = Filename("..\csv\all_csv.csv")
id = Python()
# ---------- id.python (34 lines) ----------
import sys
import clr
# import Revit API
clr.AddReference('RevitAPI')
from Autodesk.Revit.DB import *
# import Revit API UI
clr.AddReference('RevitAPIUI')
# import Revit Services
clr.AddReference('RevitServices')
import RevitServices
from RevitServices.Persistence import DocumentManager
from RevitServices.Transactions import TransactionManager 
# import ProtoGeometry 
clr.AddReference('ProtoGeometry')
from Autodesk.DesignScript.Geometry import *
# get the current Revit Document 
doc = DocumentManager.Instance.CurrentDBDocument
# get the current Revit application
app = DocumentManager.Instance.CurrentUIApplication.Application
# get the current UI application
uiapp = DocumentManager.Instance.CurrentUIApplication
app = uiapp.Application


list_wall = FilteredElementCollector(doc).OfCategory(BuiltInCategory.OST_Walls)
list1 = []

for wall in list_wall:
	typeId = wall.GetTypeId()
	type = doc.GetElement(typeId)
	a = wall.Id
	list1.append(a)

OUT = list1
# ----------------------------------------
uniqueId = Python()
# ---------- uniqueId.python (34 lines) ----------
import sys
import clr
# import Revit API
clr.AddReference('RevitAPI')
from Autodesk.Revit.DB import *
# import Revit API UI
clr.AddReference('RevitAPIUI')
# import Revit Services
clr.AddReference('RevitServices')
import RevitServices
from RevitServices.Persistence import DocumentManager
from RevitServices.Transactions import TransactionManager 
# import ProtoGeometry 
clr.AddReference('ProtoGeometry')
from Autodesk.DesignScript.Geometry import *
# get the current Revit Document 
doc = DocumentManager.Instance.CurrentDBDocument
# get the current Revit application
app = DocumentManager.Instance.CurrentUIApplication.Application
# get the current UI application
uiapp = DocumentManager.Instance.CurrentUIApplication
app = uiapp.Application


list_wall = FilteredElementCollector(doc).OfCategory(BuiltInCategory.OST_Walls)
list1 = []

for wall in list_wall:
	typeId = wall.GetTypeId()
	type = doc.GetElement(typeId)
	a = wall.UniqueId
	list1.append(a)

OUT = list1
# ----------------------------------------
categories = Categories("Walls")
all_elements_of_category = ElementsOfCategory(categories)
navisworks = Python(IN[0]=all_elements_of_category)
# ---------- navisworks.python (32 lines) ----------
list_wall = UnwrapElement(IN[0])
import sys
import clr
# import Revit API
clr.AddReference('RevitAPI')
from Autodesk.Revit.DB import *
# import Revit API UI
clr.AddReference('RevitAPIUI')
# import Revit Services
clr.AddReference('RevitServices')
import RevitServices
from RevitServices.Persistence import DocumentManager
from RevitServices.Transactions import TransactionManager 
# import ProtoGeometry 
clr.AddReference('ProtoGeometry')
from Autodesk.DesignScript.Geometry import *
# get the current Revit Document 
doc = DocumentManager.Instance.CurrentDBDocument
# get the current Revit application
app = DocumentManager.Instance.CurrentUIApplication.Application
# get the current UI application
uiapp = DocumentManager.Instance.CurrentUIApplication
app = uiapp.Application

list_wall = UnwrapElement(IN[0])
list1 = []

for wall in list_wall:
	a = wall.LookupParameter("Navisworks").AsString()
	list1.append(a)

OUT = list1
# ----------------------------------------
string = StringInput("Базовая зависимость")
базовая_зависимость = Element.GetParameterValueByName(element=all_elements_of_category, parameterName=string)
string_2 = StringInput("Номер секции №")
номер_секции = Element.GetParameterValueByName(element=all_elements_of_category, parameterName=string_2)
string_3 = StringInput("Категория")
категория = Element.GetParameterValueByName(element=all_elements_of_category, parameterName=string_3)
name = Python()
# ---------- name.python (34 lines) ----------
import sys
import clr
# import Revit API
clr.AddReference('RevitAPI')
from Autodesk.Revit.DB import *
# import Revit API UI
clr.AddReference('RevitAPIUI')
# import Revit Services
clr.AddReference('RevitServices')
import RevitServices
from RevitServices.Persistence import DocumentManager
from RevitServices.Transactions import TransactionManager 
# import ProtoGeometry 
clr.AddReference('ProtoGeometry')
from Autodesk.DesignScript.Geometry import *
# get the current Revit Document 
doc = DocumentManager.Instance.CurrentDBDocument
# get the current Revit application
app = DocumentManager.Instance.CurrentUIApplication.Application
# get the current UI application
uiapp = DocumentManager.Instance.CurrentUIApplication
app = uiapp.Application


list_wall = FilteredElementCollector(doc).OfCategory(BuiltInCategory.OST_Walls)
list1 = []
	
for wall in list_wall:
	typeId = wall.GetTypeId()
	type = doc.GetElement(typeId)
	list1.append(type)
	

OUT = list1
# ----------------------------------------
string_4 = StringInput("Длина")
длина = Element.GetParameterValueByName(element=all_elements_of_category, parameterName=string_4)
площадь = Python(IN[0]=all_elements_of_category)
# ---------- площадь.python (33 lines) ----------
list_wall = UnwrapElement(IN[0])
import sys
import clr
# import Revit API
clr.AddReference('RevitAPI')
from Autodesk.Revit.DB import *
# import Revit API UI
clr.AddReference('RevitAPIUI')
# import Revit Services
clr.AddReference('RevitServices')
import RevitServices
from RevitServices.Persistence import DocumentManager
from RevitServices.Transactions import TransactionManager 
# import ProtoGeometry 
clr.AddReference('ProtoGeometry')
from Autodesk.DesignScript.Geometry import *
# get the current Revit Document 
doc = DocumentManager.Instance.CurrentDBDocument
# get the current Revit application
app = DocumentManager.Instance.CurrentUIApplication.Application
# get the current UI application
uiapp = DocumentManager.Instance.CurrentUIApplication
app = uiapp.Application


list_wall = UnwrapElement(IN[0])
list1 = []

for wall in list_wall:
	a = wall.LookupParameter("Площадь").AsValueString()
	list1.append(a)

OUT = list1
# ----------------------------------------
объем = Python(IN[0]=all_elements_of_category)
# ---------- объем.python (33 lines) ----------
list_wall = UnwrapElement(IN[0])
import sys
import clr
# import Revit API
clr.AddReference('RevitAPI')
from Autodesk.Revit.DB import *
# import Revit API UI
clr.AddReference('RevitAPIUI')
# import Revit Services
clr.AddReference('RevitServices')
import RevitServices
from RevitServices.Persistence import DocumentManager
from RevitServices.Transactions import TransactionManager 
# import ProtoGeometry 
clr.AddReference('ProtoGeometry')
from Autodesk.DesignScript.Geometry import *
# get the current Revit Document 
doc = DocumentManager.Instance.CurrentDBDocument
# get the current Revit application
app = DocumentManager.Instance.CurrentUIApplication.Application
# get the current UI application
uiapp = DocumentManager.Instance.CurrentUIApplication
app = uiapp.Application


list_wall = UnwrapElement(IN[0])
list1 = []

for wall in list_wall:
	a = wall.LookupParameter("Объем").AsValueString()
	list1.append(a)

OUT = list1
# ----------------------------------------
string_5 = StringInput("Смещение снизу")
смещение_снизу = Element.GetParameterValueByName(element=all_elements_of_category, parameterName=string_5)
string_6 = StringInput("Смещение сверху")
смещение_сверху = Element.GetParameterValueByName(element=all_elements_of_category, parameterName=string_6)
create = List.Create(id, uniqueId, navisworks, базовая_зависимость, номер_секции, категория, name, длина, площадь, объем, смещение_снизу, смещение_сверху)
transpose = List.Transpose(create)
writeToFile = CSV.WriteToFile(file_path, transpose)
