# Dynamo graph toexcel.dyn (Dynamo 1.3.3.4111)

file_path = Filename("C:\Users\andre\Desktop\Проект\list_excel")
string = StringInput("Таблица")
number = DoubleInput(0)
categories = Categories("Walls")
all_elements_of_category = ElementsOfCategory(categories)
python_script = Python(IN[0]=all_elements_of_category)
# ---------- python_script.python (33 lines) ----------
import sys
import clr
# import Revit API
clr.AddReference('RevitAPI')
from Autodesk.Revit.DB import *
# import Revit API UI
clr.AddReference('RevitAPIUI')
# import Revit Services
clr.AddReference('RevitServices')
import RevitServices
from RevitServices.Persistence import DocumentManager
from RevitServices.Transactions import TransactionManager 
# import ProtoGeometry 
clr.AddReference('ProtoGeometry')
from Autodesk.DesignScript.Geometry import *
# get the current Revit Document 
doc = DocumentManager.Instance.CurrentDBDocument
# get the current Revit application
app = DocumentManager.Instance.CurrentUIApplication.Application
# get the current UI application
uiapp = DocumentManager.Instance.CurrentUIApplication
app = uiapp.Application


list_wall = UnwrapElement(IN[0])
list1 = []

for wall in list_wall:
	typeId = wall.GetTypeId()
	type = doc.GetElement(typeId)
	list1.append(type)

OUT = list1
# ----------------------------------------
python_script_2 = Python(IN[0]=all_elements_of_category)
# ---------- python_script_2.python (32 lines) ----------
import sys
import clr
# import Revit API
clr.AddReference('RevitAPI')
from Autodesk.Revit.DB import *
# import Revit API UI
clr.AddReference('RevitAPIUI')
# import Revit Services
clr.AddReference('RevitServices')
import RevitServices
from RevitServices.Persistence import DocumentManager
from RevitServices.Transactions import TransactionManager 
# import ProtoGeometry 
clr.AddReference('ProtoGeometry')
from Autodesk.DesignScript.Geometry import *
# get the current Revit Document 
doc = DocumentManager.Instance.CurrentDBDocument
# get the current Revit application
app = DocumentManager.Instance.CurrentUIApplication.Application
# get the current UI application
uiapp = DocumentManager.Instance.CurrentUIApplication
app = uiapp.Application


list_wall = UnwrapElement(IN[0])
list1 = []

for wall in list_wall:
	a = wall.Id
	list1.append(wall)

OUT = list1
# ----------------------------------------
create = List.Create(python_script, python_script_2)
transpose = List.Transpose(create)
writeToFile = Excel.WriteToFile(filePath=file_path, sheetName=string, startRow=number, startCol=number, data=transpose)
