# Dynamo graph vent_block.dyn (Dynamo 1.3.3.4111)

file_path = Filename("..\csv\vent_block.csv")
python_script = Python()  # unwired: IN[0]
# ---------- python_script.python (91 lines) ----------
import sys
import clr
# import Revit API
clr.AddReference('RevitAPI')
from Autodesk.Revit.DB import *
# import Revit API UI
clr.AddReference('RevitAPIUI')
# import Revit Services
clr.AddReference('RevitServices')
import RevitServices
from RevitServices.Persistence import DocumentManager
from RevitServices.Transactions import TransactionManager 
# import ProtoGeometry 
clr.AddReference('ProtoGeometry')
from Autodesk.DesignScript.Geometry import *
# get the current Revit Document 
doc = DocumentManager.Instance.CurrentDBDocument
# get the current Revit application
app = DocumentManager.Instance.CurrentUIApplication.Application
# get the current UI application
uiapp = DocumentManager.Instance.CurrentUIApplication
app = uiapp.Application


list_i = FilteredElementCollector(doc).OfCategory(BuiltInCategory.OST_Columns).WhereElementIsNotElementType().ToElements()

list1 = []
list2 = []
list3 = []
list4 = []
list5 = []
list6 = []
list7 = []
list8 = []
list9 = []
list10 = []
list11 = []
list12 = []

for i in list_i:
	typeId = i.GetTypeId()
	type = doc.GetElement(typeId)
	try:
		a = i.Id
	except:
		a = 0
	list1.append(a)
	try:
		b = i.UniqueId
	except:
		b = 0
	list2.append(b)
	try:
		c = i.LookupParameter("Navisworks").AsString()
	except:
		c = 0
	list3.append(c)
	try:
		d = i.LookupParameter("Уровень").AsValueString()
	except:
		d = 0
	list4.append(d)
	try:
		e = i.LookupParameter("Номер секции №").AsString()
	except:
		e = 0
	list5.append(e)
	try:
		f = i.LookupParameter("Категория").AsValueString()
	except:
		f = 0
	list6.append(f)
	list7.append(type)
	try:
		g = i.Name
	except:
		g = 0
	list8.append(g)
	try:
		o = i.Symbol.LookupParameter("Высота").AsValueString()
	except:
		o = 0
	list9.append(o)
	try:
		j = i.Symbol.LookupParameter("Ширина").AsValueString()
	except:
		j = 0
	list10.append(j)

	
OUT = list1, list2, list3, list4, list5, list6, list7, list8, list9, list10
# ----------------------------------------
code_block = CodeBlock(a=python_script) { a[0]; a[1]; a[2]; a[3]; a[4]; a[5]; a[6]; a[7]; a[8]; a[9]; }
create = List.Create(code_block.out0, code_block.out1, code_block.out2, code_block.out3, code_block.out4, code_block.out5, code_block.out6, code_block.out7, code_block.out8, code_block.out9)
transpose = List.Transpose(create)
writeToFile = CSV.WriteToFile(file_path, transpose)
