# Dynamo graph windows.dyn (Dynamo 1.3.3.4111)

file_path = Filename("..\csv\windows.csv")
python_script = Python()  # unwired: IN[0]
# ---------- python_script.python (96 lines) ----------
import sys
import clr
# import Revit API
clr.AddReference('RevitAPI')
from Autodesk.Revit.DB import *
# import Revit API UI
clr.AddReference('RevitAPIUI')
# import Revit Services
clr.AddReference('RevitServices')
import RevitServices
from RevitServices.Persistence import DocumentManager
from RevitServices.Transactions import TransactionManager 
# import ProtoGeometry 
clr.AddReference('ProtoGeometry')
from Autodesk.DesignScript.Geometry import *
# get the current Revit Document 
doc = DocumentManager.Instance.CurrentDBDocument
# get the current Revit application
app = DocumentManager.Instance.CurrentUIApplication.Application
# get the current UI application
uiapp = DocumentManager.Instance.CurrentUIApplication
app = uiapp.Application


list_wall = FilteredElementCollector(doc).OfCategory(BuiltInCategory.OST_Windows).WhereElementIsNotElementType().ToElements()

list1 = []
list2 = []
list3 = []
list4 = []
list5 = []
list6 = []
list7 = []
list8 = []
list9 = []
list10 = []
list11 = []
list12 = []

for wall in list_wall:
	typeId = wall.GetTypeId()
	type = doc.GetElement(typeId)
	try:
		a = wall.Id
	except:
		a = 0
	list1.append(a)
	try:
		b = wall.UniqueId
	except:
		b = 0
	list2.append(b)
	try:
		c = wall.LookupParameter("Navisworks").AsString()
	except:
		c = 0
	list3.append(c)
	try:
		d = wall.LookupParameter("Уровень").AsValueString()
	except:
		d = 0
	list4.append(d)
	try:
		e = wall.LookupParameter("Номер секции №").AsString()
	except:
		e = 0
	list5.append(e)
	try:
		f = wall.LookupParameter("Категория").AsValueString()
	except:
		f = 0
	list6.append(f)
	list7.append(type)
	try:
		g = wall.Name
	except:
		g = 0
	list8.append(g)
	try:
		i = wall.LookupParameter("Ширина").AsDouble()
	except:
		i = 0
	list9.append(i)
	try:
		j = wall.LookupParameter("Высота").AsDouble()
	except:
		j = 0
	list10.append(j)
	try:
		k = wall.LookupParameter("Марка").AsString()
	except:
		k = 0
	list11.append(k)

	
OUT = list1, list2, list3, list4, list5, list6, list7, list8, list9, list10, list11
# ----------------------------------------
code_block = CodeBlock(a=python_script) { a[0]; a[1]; a[2]; a[3]; a[4]; a[5]; a[6]; a[7]; a[8]; a[9]; a[10]; }
create = List.Create(code_block.out0, code_block.out1, code_block.out2, code_block.out3, code_block.out4, code_block.out5, code_block.out6, code_block.out7, code_block.out8, code_block.out9, code_block.out10)
transpose = List.Transpose(create)
writeToFile = CSV.WriteToFile(file_path, transpose)
